# Dynamo graph Int2Str.dyn (Dynamo 2.18.1.5096)

code_block = CodeBlock { 2; }
string_from_object = FromObject(object=code_block)
python_script = Python(IN[0]=code_block)  # CPython3
# ---------- python_script.python (1 lines) ----------
OUT = str(IN[0])
# ----------------------------------------
python_script_2 = Python(IN[0]=code_block)  # IronPython2; same code as python_script
