# Dynamo graph 7574_StringToNumberIgnoresDecimalSeparator.dyn (Dynamo 2.0.0.4467)

code_block = CodeBlock { 0.2584; }
string_from_object = FromObject(obj=code_block)
toNumber = String.ToNumber(str=string_from_object)
