# Dynamo graph 1664_TextNoteByLocationLocalizationIssues.dyn (Dynamo 1.3.0.875)

current = Document.Current()
activeView = Document.ActiveView(current)
origin = Point.Origin()
string = StringInput("Just a test....")
horizontal_alignment_style = HorizontalAlignmentStyleUI("Center")
byLocation = TextNote.ByLocation(view=activeView, location=origin, text=string, alignment=horizontal_alignment_style)
