# Dynamo graph FloorSlabShapeClockwork.dyn (Dynamo 1.3.1.1736)

select_face = DSFaceSelection()  # 1 picked in the model
firstItem = List.FirstItem(select_face)
integer_slider = IntegerSlider(11, range=0..20 step 1)
gridFromFace = Custom[Paneling.GridFromFace](surface=firstItem, U=integer_slider, V=integer_slider)  # Returns UV coordinates, XYZ coordinates and normals for a face with UV subdivision
watch = Watch(gridFromFace.Points)
select_model_element = DSModelElementSelection()  # 1 picked in the model
slabShapeByPoints = Custom[Floor.SlabShapeByPoints](points=watch, floor=select_model_element)  # Transform a slab shape based on a list of XYZs. PLEASE NOTE: Will reset any previous edits on the slab shape.
watch_2 = Watch(slabShapeByPoints)
