# Dynamo graph RoofSlabShape.dyn (Dynamo 2.0.0.4385)

select_model_element = DSModelElementSelection()  # 1 picked in the model
select_face = DSFaceSelection()  # 1 picked in the model
firstItem = List.FirstItem(list=select_face)
integer_slider = IntegerSlider(11, range=0..20 step 1)
gridFromFace = Custom[Paneling.GridFromFace](surface=firstItem, U=integer_slider, V=integer_slider)  # Returns UV coordinates, XYZ coordinates and normals for a face with UV subdivision
watch = Watch(gridFromFace.Points)
addPoint = Roof.AddPoint(roof=select_model_element, point=watch)
watch_2 = Watch(addPoint)
