# Dynamo graph 1802_DetailCurveByCurveNotDrawingCircles.dyn (Dynamo 2.0.0.4385)

current = Document.Current()
activeView = Document.ActiveView(document=current)
code_block = CodeBlock { 500; }
byCenterPointRadius = Circle.ByCenterPointRadius(radius=code_block)
byCurve = DetailCurve.ByCurve(view=activeView, curve=byCenterPointRadius)
