# Dynamo graph 1815_IsViewTemplateNotForAllViewTypes.dyn (Dynamo 2.0.0.4604)

views = Custom[Document.Views]()  # Gets all views in the document - except for 3D view templates (as long as this bug is not fixed: https://github.com/DynamoDS/Dynamo/issues/2970)
isViewTemplate = View.IsViewTemplate(view=views)
isNull = Object.IsNull(obj=isViewTemplate)
filterByBoolMask = List.FilterByBoolMask(list=views, mask=isNull)
type = Custom[View.Type](view=filterByBoolMask.in)  # Returns the type of a given view
