# Dynamo graph GeometryIssues.dyn (Dynamo 2.0.0.4297)

select_model_elements = DSModelElementsSelection()  # 3 picked in the model
geometry = Element.Geometry(element=select_model_elements)
watch = Watch(geometry)
solids = Element.Solids(element=select_model_elements)
watch_2 = Watch(solids)
geometry_2 = Custom[Element.Geometry+](element=select_model_elements)  # Returns Dynamo AND native Revit geometry of a given element
watch_3 = Watch(geometry_2.revitGeometry)
watch_4 = Watch(geometry_2.dynamoGeometry)
