# Dynamo graph 2002_AllElementsOfCategoryReturnsSomeNulls.dyn "2970_AllElementsOfCategoryViewsFails" (Dynamo 2.0.0.4604)

categories = Categories(index=587)
all_elements_of_category = ElementsOfCategory(Category=categories)
watch = Watch(all_elements_of_category)
