# Dynamo graph UVTranslationIssue.dyn (Dynamo 2.0.0.4604)

code_block = CodeBlock { 0..1..#3; }
byCoordinates = UV.ByCoordinates(u=code_block, v=code_block, lacing=CrossProduct)
flatten = List.Flatten(list=byCoordinates)
code_block_2 = CodeBlock { 1; }
chop = List.Chop(list=flatten, lengths=code_block_2)
select_face = DSFaceSelection()  # 1 picked in the model
firstItem = List.FirstItem(list=select_face)
family_types = FamilyTypes(index=0)
byParametersOnFace = AdaptiveComponent.ByParametersOnFace(uvs=chop, surface=firstItem, familyType=family_types)
