# Dynamo graph UVDistributionIssue.dyn (Dynamo 2.0.0.4604)

select_model_element = DSModelElementSelection()  # 1 picked in the model
elementFaceReferences = Element.ElementFaceReferences(element=select_model_element)
firstItem = List.FirstItem(list=elementFaceReferences)
code_block = CodeBlock { 0..1..#11; 0..1..#4; }
byCoordinates = UV.ByCoordinates(u=code_block.out0, v=code_block.out1, lacing=CrossProduct)
U = UV.U(uV=byCoordinates)
V = UV.V(uV=byCoordinates)
byParametersOnFaceReference = ReferencePoint.ByParametersOnFaceReference(elementFaceReference=firstItem, u=U, v=V)
