# Dynamo graph CWP_Limitations.dyn (Dynamo 2.6.2.15705)

categories = Categories("OST_Walls")
all_elements_of_category = ElementsOfCategory(Category=categories)
byElement = CurtainPanel.ByElement(hostingElement=all_elements_of_category)
watch = Watch(byElement)
